# Grasshopper definition Final.gh (Grasshopper 1.0.7)
# plug-ins: LunchBox

construct_point = ConstructPoint(XCoordinate="0", YCoordinate="0", ZCoordinate="3")

# ----
# Main From
number_slider = Slider(8, range=0..100)
xy = XYPlane(Origin=construct_point)
number_slider_2 = Slider(6, range=0..10)
division = Division(A=number_slider, B=1.3)
multiplication = Multiplication(A=number_slider_2)
dom = ConstructDomain(DomainStart=Slider(0.1, range=0..1), DomainEnd=Slider(0.9, range=0..1))
subtraction = Subtraction(A=multiplication, B=1)
series = Series(Start=0, Step=Slider(6, range=0..10), Count=number_slider_2)
ellipse = Ellipse(Plane=xy, Radius1=number_slider, Radius2=division)  # -> Ellipse, Focus1, Focus2
Z = UnitZ(Factor=series)
range = Range(Domain=dom, Steps=subtraction)
viewer = ParamViewer(range)
move = Move(Geometry=ellipse.Ellipse, Motion=Z)  # -> Geometry, Transform
graph = GraphMapper(
    range,
    x0=0,
    x1=1,
    y0=0,
    y1=1,
    container_name="Sine",
    Equation_px=[0, 0.5975328684],
    Equation_py=[0.5373075008, 0.3837687373])
area = Area(Geometry=move.Geometry)  # -> Area, Centroid
dom_2 = ConstructDomain(DomainStart=graph, DomainEnd=1)
remap = RemapNumbers(Value=dom_2, Source=Domain(0, 1), Target=Domain(0, 1))  # -> Mapped, Clipped
scale = Scale(Geometry=move.Geometry, Center=area.Centroid, Factor=remap.Clipped)  # -> Geometry, Transform
rotate = Rotate(Geometry=scale.Geometry, Angle=range, Plane=PlaneXY(0, 0, 0))  # -> Geometry, Transform
loft = Loft(Curves=rotate.Geometry, Options={Adjust=False, Closed=False, LoftEnds=0, LoftSimp=0, LoftType=0, Rebuild=10, Refit=0.01})

# ----
# Skin Surface
number_slider_3 = Slider(0.1, range=0..1)
dom_3 = ConstructDomain(DomainStart=Slider(0.8, range=0..1), DomainEnd=number_slider_3)
subcrv = SubCurve(BaseCurve=reparameterize(rotate.Geometry), Domain=dom_3)
neg = Negative(Value=Slider(0.5, range=0..1))
loft_2 = Loft(Curves=subcrv, Options={Adjust=False, Closed=False, LoftEnds=0, LoftSimp=0, LoftType=0, Rebuild=10, Refit=0.01})
offset = OffsetSurface(Surface=loft_2, Distance=neg, Retrim=True)
srf = Surface(offset)

srf_2 = Surface(loft)

# ----
# Pattern
panel = Panel("20")
triangle_panels_b = TrianglePanelsB(Surface=srf, UDivisions=panel, VDivisions="30")
area_2 = Area(Geometry=triangle_panels_b)  # -> Area, Centroid
smaller_than = SmallerThan(FirstNumber=area_2.Area, SecondNumber=Slider(0.6, range=0..0.6))  # -> SmallerThan, OrEqualTo
panel_2 = Panel(area_2.Area)
list_item = ListItem(List=triangle_panels_b, Index=smaller_than.SmallerThan, Wrap=True)
dispatch = Dispatch(List=triangle_panels_b, DispatchPattern=list_item)  # -> ListA, ListB
surface = Surface(dispatch.ListB)

# ----
# Structure
number_slider_4 = Slider(10, range=0..10)
negative = Negative(Value=Slider(0.3, range=0..1))
offset_surface = OffsetSurface(Surface=srf_2, Distance=negative, Retrim=True)
hexagonal_structure = HexagonalStructure(Surface=offset_surface, UDivisions=number_slider_4, VDivisions=Slider(8, range=0..10), AdjustShape=0.3, Type=False)  # -> StructureLines, StructureNodes
pipe = Pipe(Curve=hexagonal_structure.StructureLines, Radius=Slider(0.1, range=0..1), Caps=Toggle(True))

# ----
# Storis
cap_holes = CapHoles(Brep=srf_2)
unit_z = UnitZ(Factor=1)
deconstruct_brep = DeconstructBrep(Brep=triangle_panels_b)  # -> Faces, Edges, Vertices
list_item_2 = ListItem(List=flatten(deconstruct_brep.Vertices), Index=0, Wrap=True)  # -> Item, Item1
distance = Distance(PointA=list_item_2.Item, PointB=list_item_2.Item1)
contour = Contour(Shape=cap_holes, Point=Point(0, 0, 0), Direction=unit_z, Distance=distance)
boundary_surfaces = BoundarySurfaces(Edges=contour)
panel_3 = Panel(distance)
offset_surface_2 = OffsetSurface(Surface=boundary_surfaces, Distance=Slider(0.05, range=0..0.1), Retrim=Toggle(True))

# ----
# Lobby Hall
curve = Curve(contour)
flatten_tree = FlattenTree(Tree=curve, Path="{0}")
list_item_3 = ListItem(List=flatten_tree, Index=0, Wrap=True)
area_3 = Area(Geometry=list_item_3)  # -> Area, Centroid
scale_2 = Scale(Geometry=list_item_3, Center=area_3.Centroid, Factor=Slider(3, range=0..100))  # -> Geometry, Transform
unit_y = UnitY(Factor=Slider(3, range=0..10))
rotate_2 = Rotate(Geometry=scale_2.Geometry, Angle=degrees(Slider(36, range=0..100)), Plane=PlaneXY(0, 0, 0))  # -> Geometry, Transform
negative_2 = Negative(Value=unit_y)
move_2 = Move(Geometry=rotate_2.Geometry, Motion=negative_2)  # -> Geometry, Transform
boundary_surfaces_2 = BoundarySurfaces(Edges=list_item_3)
boundary_surfaces_3 = BoundarySurfaces(Edges=move_2.Geometry)
unit_z_2 = UnitZ(Factor=Slider(3, range=0..10))
solid_difference = SolidDifference(BrepsA=boundary_surfaces_2, BrepsB=boundary_surfaces_3)
negative_3 = Negative(Value=unit_z_2)
extrude = Extrude(Base=solid_difference, Direction=negative_3)
deconstruct_brep_2 = DeconstructBrep(Brep=extrude)  # -> Faces, Edges, Vertices
list_item_4 = ListItem(List=deconstruct_brep_2.Faces, Index=0, Wrap=True)
list_item_5 = ListItem(List=deconstruct_brep_2.Faces, Index=Slider(2, range=0..10), Wrap=True)
surface_2 = Surface(list_item_5)
negative_4 = Negative(Value=Slider(0.3, range=0..1))
unit_z_3 = UnitZ(Factor=negative_4)
move_3 = Move(Geometry=surface_2, Motion=unit_z_3)  # -> Geometry, Transform
diagrid_structure = DiagridStructure(Surface=move_3.Geometry, UDivisions=Slider(4, range=0..10), VDivisions=Slider(65, range=0..100), Type=True)  # -> StructureLines, StructureNodes
surface_3 = Surface(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)
pipe_2 = Pipe(Curve=diagrid_structure.StructureLines, Radius=Slider(0.04, range=0..1), Caps=0)
split_brep_multiple = SplitBrepMultiple(Brep=pipe_2, Cutters=surface_3)
offset_surface_3 = OffsetSurface(Surface=list_item_4, Distance=negative_4, Retrim=Toggle(True))
offset_surface_4 = OffsetSurface(Surface=list_item_5, Distance=negative_4, Retrim=True)
dispatch_2 = Dispatch(List=split_brep_multiple, DispatchPattern=[True, False])  # -> ListA, ListB
brep = Brep(dispatch_2.ListA)

# ----
# Cull Stories
flatten_tree_2 = FlattenTree(Tree=offset_surface_2, Path="{0}")
list_item_6 = ListItem(List=flatten_tree_2, Index="0", Wrap=True)
list_item_7 = ListItem(List=flatten_tree_2, Index="1", Wrap=True)
item_index = ItemIndex(List=flatten_tree_2, Item=[list_item_6, list_item_7])
cull_index = CullIndex(List=flatten_tree_2, Indices=item_index, Wrap=True)
brep_2 = Brep(cull_index)

# ----
# Skin Pattern
area_4 = Area(Geometry=surface)  # -> Area, Centroid
surface_closest_point = SurfaceClosestPoint(Point=area_4.Centroid, Surface=surface)  # -> Point, UVPoint, Distance
md_slider = MDSlider(
    SliderMode=0,
    slider_value=Point(0.8043168231, 0.4648533871, 0.5),
    x_domain=Domain(0, 1),
    y_domain=Domain(0, 1),
    z_domain=Domain(0, 1))
md_slider_2 = MDSlider(
    SliderMode=0,
    slider_value=Point(0.362928437, 0.4789214512, 0.5),
    x_domain=Domain(0, 1),
    y_domain=Domain(0, 1),
    z_domain=Domain(0, 1))
surface_4 = Surface(srf)
evaluate_surface = EvaluateSurface(Surface=surface, Point=surface_closest_point.UVPoint)  # -> Point, Normal, UDirection, VDirection, Frame
amplitude = Amplitude(Vector=evaluate_surface.Normal, Amplitude=Slider(0.3, range=0..1))
evaluate_surface_2 = EvaluateSurface(Surface=reparameterize(surface_4), Point=[md_slider, md_slider_2])  # -> Point, Normal, UDirection, VDirection, Frame
negative_5 = Negative(Value=amplitude)
move_4 = Move(Geometry=area_4.Centroid, Motion=negative_5)  # -> Geometry, Transform
construct_domain = ConstructDomain(DomainStart=Slider(0.1, range=0..1), DomainEnd=Slider(0, range=0..1))
closest_point = ClosestPoint(Point=evaluate_surface_2.Point, Cloud=area_4.Centroid)  # -> ClosestPoint, CPIndex, Distance
bounds = Bounds(Numbers=closest_point.Distance)
extrude_point = ExtrudePoint(Base=surface, Point=move_4.Geometry)
graft_tree = GraftTree(Tree=extrude_point, IncludeEmptyLists=True, IncludeNullItems=True)
remap_numbers = RemapNumbers(Value=closest_point.Distance, Source=bounds, Target=construct_domain)  # -> Mapped, Clipped
list_item_8 = ListItem(List=graft_tree, Index=Slider(140, range=0..1000), Wrap=True)
graph_mapper = GraphMapper(
    remap_numbers.Clipped,
    x0=0,
    x1=1,
    y0=0,
    y1=1,
    container_name="Sine",
    Equation_px=[0, 0.2513799369],
    Equation_py=[0, 0.8793272972])
deconstruct_brep_3 = DeconstructBrep(Brep=list_item_8)  # -> Faces, Edges, Vertices
list_item_9 = ListItem(List=deconstruct_brep_3.Faces, Index=0, Wrap=True)  # -> Item, Item1, Item2, Item3
graft_tree_2 = GraftTree(Tree=graph_mapper, IncludeEmptyLists=True, IncludeNullItems=True)
param_viewer = ParamViewer(graft_tree_2)
surface_5 = Surface(list_item_9.Item3)
surface_6 = Surface(list_item_9.Item1)
surface_7 = Surface(list_item_9.Item2)
deconstruct_brep_4 = DeconstructBrep(Brep=surface_6)  # -> Faces, Edges, Vertices
deconstruct_brep_5 = DeconstructBrep(Brep=surface_7)  # -> Faces, Edges, Vertices
deconstruct_brep_6 = DeconstructBrep(Brep=surface_5)  # -> Faces, Edges, Vertices
number_slider_5 = Slider(0, range=0..100)
list_item_10 = ListItem(List=deconstruct_brep_4.Edges, Index=0, Wrap=True)
list_item_11 = ListItem(List=deconstruct_brep_5.Edges, Index=0, Wrap=True)
list_item_12 = ListItem(List=deconstruct_brep_6.Edges, Index=0, Wrap=True)

rotate_axis = RotateAxis(Geometry=surface_6, Angle=graft_tree_2, Axis=list_item_10)  # -> Geometry, Transform
rotate_axis_2 = RotateAxis(Geometry=surface_5, Angle=graft_tree_2, Axis=list_item_12)  # -> Geometry, Transform
rotate_axis_3 = RotateAxis(Geometry=surface_7, Angle=graft_tree_2, Axis=list_item_11)  # -> Geometry, Transform

param_viewer_2 = ParamViewer(rotate_axis.Geometry)
merge = Merge(Data1=rotate_axis.Geometry, Data2=rotate_axis_3.Geometry, Data3=rotate_axis_2.Geometry)
brep_join = BrepJoin(Breps=merge)  # -> Breps, Closed
